# Dynamo graph script.dyn "check pile change test" (Dynamo 2.12.1.8246)
# packages: Crumple 2024.4.3, Genius Loci 2024.2.26

code_block = CodeBlock { "Checking Pile Coordinates..."; }

# group: Type Name must equal
code_block_2 = CodeBlock { "Pile"; }

# group: Search for all "STRUCTURAL FOUNDATIONS" with the type name equalling [REFER TO ORANGE GROUP BELOW]
categories = Categories("OST_StructuralFoundation")
all_elements_of_category = ElementsOfCategory(Category=categories)
name = FamilyType.Name(familyType=all_elements_of_category)
contains = String.Contains(string=name, searchFor=code_block_2)
filterByBoolMask = List.FilterByBoolMask(list=[all_elements_of_category, all_elements_of_category], mask=contains)
id = Element.Id(element=filterByBoolMask.in)
element_by_id = ElementById(Id=id)

string = StringInput("Co-ord X (E/W)")
getParameterValueByName = Element.GetParameterValueByName(element=element_by_id, parameterName=string)

# group: Retrieve Coordinates and convert to survey coordinates.
getLocation = Element.GetLocation(element=element_by_id)
convert_from_internalorigin = Custom[Convert from InternalOrigin CoordinateSystem](point=getLocation)  # package Genius Loci; Get the location point in the 3 coordinate systems : Shared Coordinates, Project Coordinates, Relative Origin Coordinates.

code_block_3 = CodeBlock(p=convert_from_internalorigin.Point_Survey_System) { [p.X]; }
code_block_4 = CodeBlock(X=code_block_3) { X[0]; }
eq = Equals(x=getParameterValueByName, y=code_block_4)
watch = Watch(eq)
string_2 = StringInput("Co-ord Y (N/S)")
getParameterValueByName_2 = Element.GetParameterValueByName(element=element_by_id, parameterName=string_2)
code_block_5 = CodeBlock(p=convert_from_internalorigin.Point_Survey_System) { [p.Y]; }
code_block_6 = CodeBlock(X=code_block_5) { X[0]; }
eq_2 = Equals(x=getParameterValueByName_2, y=code_block_6)
watch_2 = Watch(eq_2)
string_3 = StringInput("Co-ord Z (Elev)")
getParameterValueByName_3 = Element.GetParameterValueByName(element=element_by_id, parameterName=string_3)
code_block_7 = CodeBlock(p=convert_from_internalorigin.Point_Survey_System) { [p.Z]; }
code_block_8 = CodeBlock(X=code_block_7) { X[0]; }
eq_3 = Equals(x=getParameterValueByName_3, y=code_block_8)
watch_3 = Watch(eq_3)
list_create = List.Create(item0=watch, item1=watch_2, item2=watch_3)
flatten = List.Flatten(list=list_create)
uniqueItems = List.UniqueItems(list=flatten)
boolean = BoolSelector(false)
contains_2 = List.Contains(list=uniqueItems, item=boolean)
string_4 = StringInput("Pile Coordinates are out of date!")
string_5 = StringInput("Pile Coordinates are up to date!")
if_ = RefactoredIf(test=contains_2, true=string_4, false=string_5)
ui_messenger = Custom[© UI.Messenger](title=code_block, body=if_)  # package Crumple; Displays a message box with a title/body and OK/cancel button. If OK is selected, the third input's data will be passed through.
watch_4 = Watch()  # unwired: arg0
watch_5 = Watch(code_block_6)
watch_6 = Watch(element_by_id)
watch_7 = Watch(flatten)
