# Dynamo graph script.dyn (Dynamo 2.12.1.8246)
# packages: Crumple 2024.4.3, Genius Loci 2024.2.26, Data-Shapes 2024.2.114

# group: Collect all "STRUCTURAL FOUNDATIONS"
element_by_id = ElementById()  # unwired: Id
categories = Categories("OST_StructuralFoundation")
all_elements_of_category = ElementsOfCategory(Category=categories)

# group: Order Piles by X and Y co-ordinates (by survey point) - NOTUSED
getLocation = Element.GetLocation(element=element_by_id)
convert_from_internalorigin = Custom[Convert from InternalOrigin CoordinateSystem](point=getLocation)  # package Genius Loci; Get the location point in the 3 coordinate systems : Shared Coordinates, Project Coordinates, Relative Origin Coordinates.
Y = Point.Y(point=convert_from_internalorigin.Point_Survey_System)
number = DoubleInput(3)
round = Math.Round(number=Y, digits=number)
sortByKey = List.SortByKey(list=element_by_id, keys=round)
groupByKey = List.GroupByKey(list=sortByKey.sortedList, keys=sortByKey.sortedKeys)
reverse = List.Reverse(list=groupByKey.groups)
getLocation_2 = Element.GetLocation(element=reverse)
convert_from_internalorigin_2 = Custom[Convert from InternalOrigin CoordinateSystem](point=getLocation_2)
X = Point.X(point=convert_from_internalorigin_2.Point_Survey_System)
number_2 = DoubleInput(3)
round_2 = Math.Round(number=X, digits=number_2)
sortByKey_2 = List.SortByKey(list=reverse, keys=round_2, lacing=Shortest)

# group: Filter only foundations with TYPE NAME "Pile"
name = Element.Name(element=all_elements_of_category)
string = StringInput("Pile")
contains = String.Contains(string=name, searchFor=string)
filterByBoolMask = List.FilterByBoolMask(list=all_elements_of_category, mask=contains)

string_2 = StringInput("ALL")
number_3 = DoubleInput(600)

# group: First Selection - Drop Down
code_block = CodeBlock { "Select Piles to rename - filtered by parameter 'Pile Category' or ALL"; }
string_3 = StringInput("Pile Category")
getParameterValueByName = Element.GetParameterValueByName(element=filterByBoolMask.in, parameterName=string_3)
uniqueItems = List.UniqueItems(list=getParameterValueByName)
list_sortnatural = Custom[List SortNatural](list=uniqueItems)  # package Genius Loci; Sorts a specified list in natural order in either ascending or descending order.

join = List.Join(list0=list_sortnatural, list1=string_2)

# group (continued): First Selection - Drop Down
ui_dropdownform = Custom[🐍 UI.DropdownForm](formTitle=code_block, keys=join, values=join, formWidth=number_3)  # package Crumple; Creates a basic dropdown form from a set of keys and values. If cancelled, the form will return nothing (null).

# group: Search for Parameter
code_block_2 = CodeBlock { "Pile Category"; }

getParameterValueByName_2 = Element.GetParameterValueByName(element=filterByBoolMask.in, parameterName=code_block_2)

# group (continued): Collect all "STRUCTURAL FOUNDATIONS"
contains_2 = String.Contains(string=getParameterValueByName_2, searchFor=ui_dropdownform.chosenValue)

# group: CHECK IF "ALL"
string_4 = StringInput("ALL")
eq = string_4 == ui_dropdownform.chosenValue
eq_2 = filterByBoolMask.in == filterByBoolMask.in
flow_waitfor = Custom[© Flow.WaitFor](data=contains_2, waitFor=eq)  # package Crumple; Tells the first input to wait for the second input to arrive, then passes on the first input. Really useful for scripts which have branching paths that rely on their outputs to carry each other forward. Quite a few custom packages have a 'passthrough' or 'waitfor' node. I use these all the time, so find it useful to have them contained in this package also.
if_ = RefactoredIf(test=eq, true=eq_2, false=flow_waitfor)

# group (continued): Collect all "STRUCTURAL FOUNDATIONS"
filterByBoolMask_2 = List.FilterByBoolMask(list=filterByBoolMask.in, mask=if_)
familytype_name = Custom[© FamilyType.Name](familyTypes=filterByBoolMask_2.in)  # package Crumple; For a family type or list of family types, returns the type names.
id = Element.Id(element=filterByBoolMask_2.in)

# group: Validate drop down was used + error message
contains_3 = List.Contains(list=join, item=ui_dropdownform.chosenValue)
watch = Watch(contains_3)
code_block_3 = CodeBlock { "Renumber: Group "; }
code_block_4 = CodeBlock { "ERROR! Drop down was not used or Null was selected, Cancel and try again."; }

code_block_5 = CodeBlock { "Pile Renumbering"; }
string_5 = StringInput("ALL")
eq_3 = ui_dropdownform.chosenValue == string_5
code_block_6 = CodeBlock { "Renumber: "; }
if_2 = RefactoredIf(test=eq_3, true=code_block_6, false=code_block_3)

# group (continued): Validate drop down was used + error message
add = if_2 + ui_dropdownform.chosenValue
if_3 = If(test=contains_3, true=add, false=code_block_4)

file_path = Filename(".\Pile Numbering Guidance Doc.docx")
code_block_7 = CodeBlock { "Cancel"; }

# group: User Interface + extract user input
code_block_8 = CodeBlock { "Confirm"; }
code_block_9 = CodeBlock { "Pile Prefix"; "P"; }
textbox_data = Custom[TextBox Data](InputName=code_block_9.out0, DefaultText=code_block_9.out1)  # package Data-Shapes; Create Data for TextBox input in UI.MultipleInputForm ++ . Check out www.data-shapes.net for more informations
code_block_10 = CodeBlock { "Pile No. Padding"; "3"; }
textbox_data_2 = Custom[TextBox Data](InputName=code_block_10.out0, DefaultText=code_block_10.out1)
list_create = List.Create(item0=textbox_data, item1=textbox_data_2)
boolean = BoolSelector(true)
multipleinputform = Custom[MultipleInputForm ++](Description_optional=if_3, ButtonText_optional=code_block_8, Inputs=list_create, Toggle=boolean, LinkToHelp_optional=file_path, CancelButtonText_optional=code_block_7)  # package Data-Shapes; Create a form with multiple inputs. see www.data-shapes.net for tutorials and infos!
watch_2 = Watch(multipleinputform.User_Inputs)
code_block_11 = CodeBlock { 1; }
code_block_12 = CodeBlock { 2; }
slice = List.Slice(list=watch_2, start=code_block_11, end=code_block_12)
watch_3 = Watch(slice)
code_block_13 = CodeBlock(X=watch_3) { X[0]; }
watch_4 = Watch(code_block_13)
toNumber = String.ToNumber(string=watch_4)
code_block_14 = CodeBlock { 0; }
code_block_15 = CodeBlock { 1; }
slice_2 = List.Slice(list=watch_2, start=code_block_14, end=code_block_15)
watch_5 = Watch(slice_2)
code_block_16 = CodeBlock(X=watch_5) { X[0]; }
watch_6 = Watch(code_block_16)
length = String.Length(string=watch_6)
add_2 = length + toNumber

boolean_2 = BoolSelector(true)
boolean_3 = BoolSelector(false)
if_4 = If(test=multipleinputform.Was_Cancelled, true=boolean_2, false=boolean_3)
code_block_17 = CodeBlock { "Process Cancelled by User!"; }
string_6 = StringInput("ALL")
eq_4 = ui_dropdownform.chosenValue == string_6
code_block_18 = CodeBlock { ""; }
code_block_19 = CodeBlock { "Pile Group "; }
if_5 = RefactoredIf(test=eq_4, true=code_block_18, false=code_block_19)
add_3 = if_5 + ui_dropdownform.chosenValue
code_block_20 = CodeBlock { " successfully renumbered"; }
add_4 = add_3 + code_block_20
if_6 = If(test=if_4, true=code_block_17, false=add_4)
element_by_id_2 = ElementById(Id=id)

# group: Order Piles by X and Y co-ordinates (by basepoint)
getLocation_3 = Element.GetLocation(element=element_by_id_2)
Y_2 = Point.Y(point=getLocation_3)
number_4 = DoubleInput(3)
round_3 = Math.Round(number=Y_2, digits=number_4)
sortByKey_3 = List.SortByKey(list=element_by_id_2, keys=round_3)
groupByKey_2 = List.GroupByKey(list=sortByKey_3.sortedList, keys=sortByKey_3.sortedKeys)
reverse_2 = List.Reverse(list=groupByKey_2.groups)
getLocation_4 = Element.GetLocation(element=reverse_2)
X_2 = Point.X(point=getLocation_4)
number_5 = DoubleInput(3)
round_4 = Math.Round(number=X_2, digits=number_5)
sortByKey_4 = List.SortByKey(list=reverse_2, keys=round_4, lacing=Shortest)

# group: Add Prefix and padding (P00X)
flatten = List.Flatten(list=sortByKey_4.sortedList)
string_7 = StringInput("Mark")
count = List.Count(list=flatten)
code_block_21 = CodeBlock(c=count) { (1..c)+""; }
code_block_22 = CodeBlock { "0"; }
padLeft = String.PadLeft(string=code_block_21, newLength=toNumber, padChars=code_block_22)
padLeft_2 = String.PadLeft(string=padLeft, newLength=add_2, padChars=watch_6)
setParameterByName = Element.SetParameterByName(element=flatten, parameterName=string_7, value=padLeft_2)

ui_messenger = Custom[© UI.Messenger](title=code_block_5, body=if_6, pass=setParameterByName)  # package Crumple; Displays a message box with a title/body and OK/cancel button. If OK is selected, the third input's data will be passed through.
watch_7 = Watch(join)
watch_8 = Watch(contains_2)
