# Dynamo graph script.dyn (Dynamo 2.16.1.2727)
# packages: Crumple 2024.4.3, Genius Loci 2024.2.26

# group: Search for all "STRUCTURAL FOUNDATIONS" with the type name equalling [REFER TO ORANGE GROUP BELOW]
categories = Categories("OST_StructuralFoundation")
all_elements_of_category = ElementsOfCategory(Category=categories)
name = FamilyType.Name(familyType=all_elements_of_category)

# group: Type Name must equal
code_block = CodeBlock { "Pile"; }

eq = name == code_block

# group (continued): Search for all "STRUCTURAL FOUNDATIONS" with the type name equalling [REFER TO ORANGE GROUP BELOW]
filterByBoolMask = List.FilterByBoolMask(list=[all_elements_of_category, all_elements_of_category], mask=eq)
id = Element.Id(element=filterByBoolMask.in)
element_by_id = ElementById(Id=id)

# group: Retrieve Coordinates and convert to survey coordinates.
getLocation = Element.GetLocation(element=element_by_id)
convert_from_internalorigin = Custom[Convert from InternalOrigin CoordinateSystem](point=getLocation)  # package Genius Loci; Get the location point in the 3 coordinate systems : Shared Coordinates, Project Coordinates, Relative Origin Coordinates.

flatten = List.Flatten(list=convert_from_internalorigin.Point_Survey_System)

# group: Compare custom parameters to survey point
string = StringInput("Co-ord X (E/W)")
getParameterValueByName = Element.GetParameterValueByName(element=element_by_id, parameterName=string)
code_block_2 = CodeBlock(p=flatten) { [p.X]; }
code_block_3 = CodeBlock(X=code_block_2) { X[0]; }
eq_2 = Equals(x=getParameterValueByName, y=code_block_3)
string_2 = StringInput("Co-ord Y (N/S)")
getParameterValueByName_2 = Element.GetParameterValueByName(element=element_by_id, parameterName=string_2)
code_block_4 = CodeBlock(p=flatten) { [p.Y]; }
code_block_5 = CodeBlock(X=code_block_4) { X[0]; }
eq_3 = Equals(x=getParameterValueByName_2, y=code_block_5)
string_3 = StringInput("Co-ord Z (Elev)")
getParameterValueByName_3 = Element.GetParameterValueByName(element=element_by_id, parameterName=string_3)
code_block_6 = CodeBlock(p=flatten) { [p.Z]; }
code_block_7 = CodeBlock(X=code_block_6) { X[0]; }
eq_4 = Equals(x=getParameterValueByName_3, y=code_block_7)

watch = Watch(eq_2)
watch_2 = Watch(eq_3)
watch_3 = Watch(eq_4)

# group: Check if any results fails and decide output message
code_block_8 = CodeBlock { "Checking Pile Coordinates..."; }
list_create = List.Create(item0=watch, item1=watch_2, item2=watch_3)
flatten_2 = List.Flatten(list=list_create)
uniqueItems = List.UniqueItems(list=flatten_2)
boolean = BoolSelector(false)
contains = List.Contains(list=uniqueItems, item=boolean)
string_4 = StringInput("Pile Coordinates are out of date!")
string_5 = StringInput("Pile Coordinates are up to date!")
if_ = RefactoredIf(test=contains, true=string_4, false=string_5)
ui_messenger = Custom[© UI.Messenger](title=code_block_8, body=if_)  # package Crumple; Displays a message box with a title/body and OK/cancel button. If OK is selected, the third input's data will be passed through.
watch_4 = Watch(flatten_2)

watch_5 = Watch(code_block_5)
watch_6 = Watch(element_by_id)

# group: Write to Pile Comments if E+N+Z Correct/Incorrect
filterByBoolMask_2 = List.FilterByBoolMask(list=element_by_id, mask=eq_2)
filterByBoolMask_3 = List.FilterByBoolMask(list=element_by_id, mask=eq_3)
filterByBoolMask_4 = List.FilterByBoolMask(list=element_by_id, mask=eq_4)
list_create_2 = List.Create(item0=filterByBoolMask_2.out, item1=filterByBoolMask_3.out, item2=filterByBoolMask_4.out)
flatten_3 = List.Flatten(list=list_create_2)
string_6 = StringInput("Comments")
parameterByName = Parameter.ParameterByName(element=flatten_3, name=string_6)
string_7 = StringInput("E+N Incorrect")
setValue = Parameter.SetValue(parameter=parameterByName, value=string_7)
list_create_3 = List.Create(item0=filterByBoolMask_2.in, item1=filterByBoolMask_3.in, item2=filterByBoolMask_4.in)
string_8 = StringInput("Comments")
parameterByName_2 = Parameter.ParameterByName(element=list_create_3, name=string_8)
string_9 = StringInput("E+N Correct")
setValue_2 = Parameter.SetValue(parameter=parameterByName_2, value=string_9)
watch_7 = Watch(filterByBoolMask_2.out)

watch_8 = Watch(flatten)
watch_9 = Watch(getParameterValueByName_3)
